# Grasshopper definition generativehouse.gh (Grasshopper 1.0.7)
# plug-ins: Pufferfish

site_width = Slider(15, range=0..50)

# ---- group: RH_IN:slope
roof_slope = Slider(20, range=1..40)

# ---- group: RH_IN:height
inner_height = Slider(2.7, range=2.7..4)

# ---- group: RH_IN:house-depth
house_depth = Slider(10, range=5..20)

# ---- group: RH_IN:house-width
house_width = Slider(10, range=5..20)

# ---- group: RH_IN:count
number_of_rooms = Slider(5, range=3..10)

# ---- group: RH_IN:location
entrance_location = Slider(0, range=0..3)

# ---- group: RH_IN:window-count
number_of_windows = Slider(3, range=2..5)

# ---- group: RH_IN:sill-height
sill_height = Slider(0.1, range=0..1)

# ---- group: RH_IN:window-height
window_height = Slider(2.1, range=0..3)

# ---- group: RH_IN:window-width
window_width = Slider(1.5, range=0..3)

# ---- group: RH_IN:pool-large
pool_depth = Slider(5, range=3..15)

# ----
site_depth = Slider(25, range=0..50)

# ---- group: RH_IN:generator
room_generator = Slider(0, range=0..10)

# ---- group: RH_IN:pool-width
pool_width = Slider(10, range=3..15)

# ----
pt = Point(Point(8.650253316, 7.637916427, 0))
dom = ConstructDomain(DomainStart=0, DomainEnd=site_width)
dom_2 = ConstructDomain(DomainStart=0, DomainEnd=site_depth)
addition = Addition(A=number_of_windows, B=1)
rectangle = Rectangle(Plane=PlaneXY(0, 0, 0), XSize=dom, YSize=dom_2, Radius=0)  # -> Rectangle, Length
pt_2 = Point(Point(4.583148748, 17.51311193, 0))
terrain_height = Slider(-3, range=-3..0)
boundary = BoundarySurfaces(Edges=rectangle.Rectangle)
Z = UnitZ(Factor=terrain_height)
extr = Extrude(Base=boundary, Direction=Z)
neg = Negative(Value=Slider(0.25, range=0..1))
brep = Brep(extr)
srf = Surface(boundary)
crv = Curve(rectangle.Rectangle)
srf_2 = Surface(srf)
crv_2 = Curve(crv)
brep_2 = Brep(brep)
debrep = DeconstructBrep(Brep=brep_2)  # -> Faces, Edges, Vertices

# ---- group: RH_IN:show-roof
toggle = BooleanToggle(False)

# ----
cull_i = CullIndex(List=debrep.Faces, Indices=Slider(0, range=0..5), Wrap=True)

# ---- group: RH_OUT:terrain
mesh = Mesh(cull_i)

# ----
brep_cp = BrepClosestPoint(Point=pt, Brep=boundary)  # -> Point, Normal, Distance
explode = Explode(Curve=rectangle.Rectangle, Recursive=True)  # -> Segments, Vertices
pull = PullPoint(Point=brep_cp.Point, Geometry=graft(explode.Segments), ClosestOnly=True)  # -> ClosestPoint, Distance
bang = ExplodeTree(Data=pull.Distance)  # -> Branch0, Branch1, Branch2, Branch3
data = Data(flatten([bang.Branch2, bang.Branch0]))
data_2 = Data(flatten([bang.Branch1, bang.Branch3]))
bnd = Bounds(Numbers=data_2)
bnd_2 = Bounds(Numbers=data)
dedomain = DeconstructDomain(Domain=bnd)  # -> Start, End
dedomain_2 = DeconstructDomain(Domain=bnd_2)  # -> Start, End
division = Division(A=house_depth, B=2)
division_2 = Division(A=house_width, B=2)
expression = Expression(x=division, y=dedomain.Start, Expression="If(x>y,y,x)")
expression_2 = Expression(x=division_2, y=dedomain_2.Start, Expression="If(x>y,y,x)")
neg_2 = Negative(Value=expression_2)
neg_3 = Negative(Value=expression)
dom_3 = ConstructDomain(DomainStart=neg_3, DomainEnd=expression)
dom_4 = ConstructDomain(DomainStart=neg_2, DomainEnd=expression_2)
rectangle_2 = Rectangle(Plane=brep_cp.Point, XSize=dom_3, YSize=dom_4, Radius=0)  # -> Rectangle, Length
boundary_2 = BoundarySurfaces(Edges=rectangle_2.Rectangle)
popgeo = PopulateGeometry(Geometry=boundary_2, Count=number_of_rooms, Seed=room_generator)
voronoi = Voronoi(Points=popgeo, BruteForceOverride=False)

brep_cp_2 = BrepClosestPoint(Point=pt_2, Brep=boundary)  # -> Point, Normal, Distance
explode_2 = Explode(Curve=rectangle.Rectangle, Recursive=True)  # -> Segments, Vertices
pull_2 = PullPoint(Point=brep_cp_2.Point, Geometry=graft(explode_2.Segments), ClosestOnly=True)  # -> ClosestPoint, Distance
bang_2 = ExplodeTree(Data=pull_2.Distance)  # -> Branch0, Branch1, Branch2, Branch3
data_3 = Data(flatten([bang_2.Branch1, bang_2.Branch3]))
data_4 = Data(flatten([bang_2.Branch2, bang_2.Branch0]))
bnd_3 = Bounds(Numbers=data_3)
bnd_4 = Bounds(Numbers=data_4)
dedomain_3 = DeconstructDomain(Domain=bnd_4)  # -> Start, End
dedomain_4 = DeconstructDomain(Domain=bnd_3)  # -> Start, End
division_3 = Division(A=pool_depth, B=2)
division_4 = Division(A=pool_width, B=2)
brep_cp_3 = BrepClosestPoint(Point=pt_2, Brep=boundary_2)  # -> Point, Normal, Distance
subtraction = Subtraction(A=brep_cp_3.Distance, B=Slider(0.3, range=0..1))
expression_3 = Expression(x=division_3, y=dedomain_4.Start, Expression="If(x>y,y,x)")
expression_4 = Expression(x=division_4, y=dedomain_3.Start, Expression="If(x>y,y,x)")
expression_5 = Expression(x=division_4, y=subtraction, Expression="If(x>y,y,x)")
neg_4 = Negative(Value=expression_3)
expression_6 = Expression(x=expression_4, y=expression_5, Expression="If(x>y,y,x)")
dom_5 = ConstructDomain(DomainStart=neg_4, DomainEnd=expression_3)
neg_5 = Negative(Value=expression_6)
dom_6 = ConstructDomain(DomainStart=neg_5, DomainEnd=expression_6)
neg_6 = Negative(Value=Slider(1.7, range=0..10))
Z_2 = UnitZ(Factor=neg_6)
rectangle_3 = Rectangle(Plane=brep_cp_2.Point, XSize=dom_5, YSize=dom_6, Radius=0)  # -> Rectangle, Length
boundary_3 = BoundarySurfaces(Edges=rectangle_3.Rectangle)
extr_2 = Extrude(Base=boundary_3, Direction=Z_2)

offset = OffsetCurve(Curve=rectangle_2.Rectangle, Distance=neg, Plane=PlaneXY(0, 0, 0), Corners=1)

trim = TrimWithRegion(Curve=voronoi, Region=offset)  # -> Inside, Outside

explode_3 = Explode(Curve=rectangle_2.Rectangle, Recursive=True)  # -> Segments, Vertices
item = ListItem(List=explode_3.Segments, Index=entrance_location, Wrap=True)
crv_3 = Curve(item)
door_height = Slider(2.1, range=0..10)
door_width = Slider(0.8, range=0..1)
eval = EvaluateCurve(Curve=reparameterize(crv_3), Parameter=Slider(0.5, range=0..1))  # -> Point, Tangent, Angle
division_5 = Division(A=door_width, B=2)
unit = UnitVector(Vector=eval.Tangent)
multiplication = Multiplication(A=unit, B=division_5)
neg_7 = Negative(Value=multiplication)
move = Move(Geometry=eval.Point, Motion=[multiplication, neg_7])  # -> Geometry, Transform
explode_4 = Explode(Curve=rectangle_2.Rectangle, Recursive=True)  # -> Segments, Vertices
divide = DivideCurve(Curve=explode_4.Segments, Count=addition, Kinks=False)  # -> Points, Tangents, Parameters
line = LineSDL(Start=move.Geometry, Direction=Vector(0, 0, 1), Length=door_height)
shift = ShiftList(List=divide.Points, Shift=1, Wrap=invert(True))
end = EndPoints(Curve=line)  # -> Start, End
pline = PolyLine(Vertices=end.End, Closed=False)
shift_2 = ShiftList(List=shift, Shift=Slider(-1, range=-1..1), Wrap=invert(True))
pline_2 = PolyLine(Vertices=end.Start, Closed=False)
crv_4 = Curve([line, pline, pline_2])
Z_3 = UnitZ(Factor=sill_height)
pt_3 = Point(shift_2)
md_slider = MDSlider(SliderMode=0, slider_value=Point(0.5, 0.5, 0.5), x_domain=Domain(0, 1), y_domain=Domain(0, 1), z_domain=Domain(0, 1))
boundary_4 = BoundarySurfaces(Edges=crv_4)
move_2 = Move(Geometry=pt_3, Motion=Z_3)  # -> Geometry, Transform
evalsrf = EvaluateSurface(Surface=reparameterize(boundary_4), Point=md_slider)  # -> Point, Normal, UDirection, VDirection, Frame
neg_8 = Negative(Value=evalsrf.Normal)
extr_3 = Extrude(Base=boundary_4, Direction=[evalsrf.Normal, neg_8])  # -> flatten(Extrusion)
Z_4 = UnitZ(Factor=inner_height)
sunion = SolidUnion(Breps=extr_3)
extr_4 = Extrude(Base=explode_4.Segments, Direction=Z_4)
brepinc = PointInBrep(Brep=sunion, Point=move_2.Geometry, Strict=False)
cull = CullPattern(List=move_2.Geometry, CullPattern=invert(brepinc))
intcrv = Interpolate(Vertices=divide.Points, Degree=3, Periodic=False, KnotStyle=1)  # -> Curve, Length, Domain
division_6 = Division(A=intcrv.Length, B=addition)  # -> flatten(Result)
srf_cp = SurfaceClosestPoint(Point=cull, Surface=reparameterize(graft(extr_4)))  # -> Point, UVPoint, Distance
evalsrf_2 = EvaluateSurface(Surface=reparameterize(graft(extr_4)), Point=srf_cp.UVPoint)  # -> Point, Normal, UDirection, VDirection, Frame
expression_7 = Expression(x=window_width, y=division_6, Expression="If(x>y,y,x)")
subtraction_2 = Subtraction(A=inner_height, B=Slider(0.3, range=0..1))
subtraction_3 = Subtraction(A=subtraction_2, B=sill_height)
pl = PlaneNormal(Origin=cull, ZAxis=evalsrf_2.Normal)
xz = XZPlane(Origin=Point(0, 0, 0))
division_7 = Division(A=expression_7, B=2)
expression_8 = Expression(x=subtraction_3, y=window_height, Expression="If(x>y,y,x)")
align = AlignPlanes(Planes=pl, Master=xz)  # -> simplify(Planes)
neg_9 = Negative(Value=division_7)
dom_7 = ConstructDomain(DomainStart=neg_9, DomainEnd=division_7)
rectangle_4 = Rectangle(Plane=align, XSize=graft(dom_7), YSize=expression_8, Radius=0)  # -> Rectangle, Length

crv_5 = Curve(flatten(trim.Inside))
crv_6 = Curve(rectangle_2.Rectangle)

explode_5 = Explode(Curve=rectangle_2.Rectangle, Recursive=True)  # -> Segments, Vertices
hframe = HorizontalFrame(Curve=reparameterize(explode_5.Segments), Parameter="0.5")
rad = Radians(Degrees=roof_slope)
multiplication_2 = Multiplication(A=house_width, B=Slider(1, range=1..4))
deplane = DeconstructPlane(Plane=hframe)  # -> Origin, XAxis, YAxis, ZAxis
dom_8 = ConstructDomain(DomainStart=expr("-x/2", multiplication_2), DomainEnd=expr("x/2", multiplication_2))
rot3d = Rotate3D(Geometry=hframe, Angle=rad, Center=hframe, Axis=deplane.XAxis)  # -> Geometry, Transform
rectangle_5 = Rectangle(Plane=rot3d.Geometry, XSize=dom_8, YSize=multiplication_2, Radius=0)  # -> Rectangle, Length
boundary_5 = BoundarySurfaces(Edges=flatten(rectangle_5.Rectangle))
brep_3 = Brep(boundary_2)
bvol = BoundaryVolume(Boundaries=[boundary_5, brep_3])
Z_5 = UnitZ(Factor=inner_height)
move_3 = Move(Geometry=bvol, Motion=Z_5)  # -> Geometry, Transform

crv_7 = Curve([line, pline])
crv_8 = Curve(rectangle_4.Rectangle)

inner_walls = Slider(0.05, range=0..0.2)
crv_9 = Curve(flatten(crv_5))
neg_10 = Negative(Value=inner_walls)
offset_2 = OffsetCurve(Curve=crv_9, Distance=neg_10, Plane=PlaneXY(0, 0, 0), Corners=1)
end_2 = EndPoints(Curve=flatten(offset_2))  # -> Start, End
pt_4 = Point(end_2.End)
pt_5 = Point(end_2.Start)
cp = ClosestPoint(Point=end_2.Start, Cloud=pt_4)  # -> ClosestPoint, CPIndex, Distance
ln = Line(StartPoint=pt_5, EndPoint=cp.ClosestPoint)
join = JoinCurves(Curves=simplify(flatten([offset_2, ln])), Preserve=False)
Z_6 = UnitZ(Factor=inner_height)
boundary_6 = BoundarySurfaces(Edges=join)

crv_10 = Curve(crv_6)
move_4 = Move(Geometry=crv_10, Motion=Z_6)  # -> Geometry, Transform
brep_4 = Brep(move_3.Geometry)
filter = StreamFilter(Gate=toggle, Stream0=brep_4)
move_5 = Move(Geometry=boundary_6, Motion=Z_6)  # -> Geometry, Transform
extr_5 = Extrude(Base=join, Direction=Z_6)
brep_5 = Brep(extr_2)

# ---- group: RH_OUT:roof
mesh_2 = Mesh(filter)

# ---- group: RH_OUT:floor
mesh_3 = Mesh(boundary_2)

# ---- group: RH_OUT:walls
mesh_4 = Mesh(extr_5)

# ---- group: RH_OUT:pool
mesh_5 = Mesh(brep_5)

# ----
debrep_2 = DeconstructBrep(Brep=rectangle.Rectangle)  # -> Faces, Edges, Vertices
item_2 = ListItem(List=debrep_2.Edges, Index=0, Wrap=True)  # -> Item, Item1, Item2, Item3
multiplication_3 = Multiplication(A=site_depth, B=Slider(51, range=0..100))
flip = FlipCurve(Curve=item_2.Item1)  # -> Curve, Flag
division_8 = Division(A=multiplication_3, B=Slider(100, range=0..100))
crv_11 = Curve([item_2.Item3, flip.Curve])
divlength = DivideLength(Curve=crv_11, Length=division_8)  # -> Points, Tangents, Parameters
item_3 = ListItem(List=divlength.Points, Index=Slider(1, range=0..1), Wrap=True)
bang_3 = ExplodeTree(Data=item_3)  # -> Branch0, Branch1
ln_2 = Line(StartPoint=bang_3.Branch0, EndPoint=bang_3.Branch1)
srfsplit = SurfaceSplit(Surface=boundary, Curves=ln_2)
rdiff = RegionDifference(CurvesA=srfsplit, CurvesB=boundary_2)

boundary_7 = BoundarySurfaces(Edges=rdiff)

item_4 = ListItem(List=boundary_7, Index=0, Wrap=True)  # -> Item, Item1

rdiff_2 = RegionDifference(CurvesA=item_4.Item1, CurvesB=boundary_3)
rdiff_3 = RegionDifference(CurvesA=item_4.Item, CurvesB=boundary_3)
srf_3 = Surface(rdiff_3)
srf_4 = Surface(rdiff_2)

# ---- group: RH_OUT:grass
mesh_6 = Mesh(srf_3)

# ---- group: RH_OUT:concrete
mesh_7 = Mesh(srf_4)

# ----
boundary_8 = BoundarySurfaces(Edges=crv_8)
brep_6 = Brep(extr_4)
brep_7 = Brep(boundary_4)
rdiff_4 = RegionDifference(CurvesA=brep_6, CurvesB=boundary_8)  # -> simplify(Result)
walls = Slider(0.3, range=0..0.3)

rdiff_5 = RegionDifference(CurvesA=brep_6, CurvesB=brep_7)

crv_12 = Curve(crv_8)
crv_13 = Curve(crv_7)
multiplication_4 = Multiplication(A=evalsrf.Normal, B=Slider(0.25, range=0..1))
multiplication_5 = Multiplication(A=evalsrf_2.Normal, B=Slider(0.25, range=0..1))
neg_11 = Negative(Value=multiplication_4)
brep_8 = Brep(brep_7)
move_6 = Move(Geometry=crv_12, Motion=multiplication_5)  # -> simplify(flatten(Geometry)), Transform
move_7 = Move(Geometry=crv_13, Motion=neg_11)  # -> simplify(flatten(Geometry)), Transform
move_8 = Move(Geometry=brep_8, Motion=neg_11)  # -> simplify(flatten(Geometry)), Transform
neg_12 = Negative(Value=Slider(0.05, range=0..0.1))
neg_13 = Negative(Value=Slider(0.05, range=0..0.1))
join_2 = JoinCurves(Curves=move_7.Geometry, Preserve=False)
offset_3 = OffsetCurve(Curve=move_6.Geometry, Distance=neg_13, Plane=move_6.Geometry, Corners=1)  # -> flatten(Curve)
offset_4 = OffsetCurve(Curve=join_2, Distance=neg_12, Plane=move_8.Geometry, Corners=1)  # -> flatten(Curve)
multiplication_6 = Multiplication(A=flatten(evalsrf_2.Normal), B=Slider(0.05, range=0..0.1))
rulesrf = RuledSurface(CurveA=move_6.Geometry, CurveB=offset_3)
end_3 = EndPoints(Curve=offset_4)  # -> Start, End
multiplication_7 = Multiplication(A=flatten(evalsrf.Normal), B=Slider(0.05, range=0..0.1))
ln_3 = Line(StartPoint=end_3.Start, EndPoint=end_3.End)
rulesrf_2 = RuledSurface(CurveA=join_2, CurveB=offset_4)
boundary_9 = BoundarySurfaces(Edges=[offset_4, ln_3])

neg_14 = Negative(Value=walls)
offset_5 = OffsetCurve(Curve=move_4.Geometry, Distance=neg_14, Plane=PlaneXY(0, 0, 0), Corners=1)
extr_6 = Extrude(Base=rulesrf, Direction=multiplication_6)
extr_7 = Extrude(Base=[rulesrf_2, boundary_9], Direction=multiplication_7)
boundary_10 = BoundarySurfaces(Edges=offset_3)
boundary_11 = BoundarySurfaces(Edges=flatten([offset_5, move_4.Geometry]))

# ---- group: RH_OUT:window
mesh_8 = Mesh(boundary_10)

# ---- group: RH_OUT:frame
mesh_9 = Mesh(extr_6)

# ---- group: RH_OUT:door
mesh_10 = Mesh(extr_7)

# ---- group: RH_OUT:section
mesh_11 = Mesh(boundary_11)

# ----
rint = RegionIntersection(CurvesA=rdiff_4, CurvesB=rdiff_5)  # -> simplify(Result)

tstat = TreeStatistics(Tree=rint)  # -> Paths, Length, Count
item_5 = ListItem(List=tstat.Paths, Index=entrance_location, Wrap=True)
branch = TreeBranch(Tree=rint, Path=item_5, MaintainPaths=True)
viewer = ParamViewer(branch)
split = SplitTree(Data=rdiff_4, Masks=flatten(viewer))  # -> Positive, Negative
merge = Merge(Data1=split.Negative, Data2=branch)

boundary_12 = BoundarySurfaces(Edges=merge)
join_3 = BrepJoin(Breps=flatten(boundary_12))  # -> Breps, Closed
offsrf = OffsetSurface(Surface=join_3.Breps, Distance=walls, BothSides=False, CreateSolid=True)
sunion_2 = SolidUnion(Breps=offsrf)
fmerge = MergeFaces(Brep=sunion_2)  # -> Breps, Before, After

brep_9 = Brep(fmerge.Breps)

# ---- group: RH_OUT:house
mesh_12 = Mesh(brep_9)
